# Grasshopper definition aldo.gh (Grasshopper 0.9.76)
# plug-ins: Anemone

polygon = Polygon(Plane=PlaneXY(0, 0, 0), Radius=Slider(5, range=0..10), Segments=Slider(3, range=0..10), FilletRadius=0)  # -> Polygon, Length
construct_point = ConstructPoint(XCoordinate=0, YCoordinate=0, ZCoordinate=0)
explode = Explode(Curve=polygon.Polygon, Recursive=True)  # -> Segments, Vertices
number_slider = Slider(0.282, range=0..5)
point_on_curve = PointOnCurve(explode.Segments, parameter=0.5)
vector_2pt = Vector2Pt(PointA=point_on_curve, PointB=construct_point, Unitize=False)  # -> Vector, Length
negative = Negative(Value=number_slider)
line_sdl = LineSDL(Start=point_on_curve, Direction=vector_2pt.Vector, Length=Slider(0.856, range=0..5))
offset = Offset(Curve=graft(line_sdl), Distance=number_slider, Plane=PlaneXY(0, 0, 0), Corners=1)  # -> simplify(Curve)
offset_2 = Offset(Curve=graft(line_sdl), Distance=negative, Plane=PlaneXY(0, 0, 0), Corners=1)  # -> simplify(Curve)
end_points = EndPoints(Curve=offset)  # -> Start, End
end_points_2 = EndPoints(Curve=offset_2)  # -> Start, End
merge = Merge(Data1=end_points.Start, Data2=end_points.End, Data3=end_points_2.End, Data4=end_points_2.Start)
polyline = PolyLine(Vertices=merge, Closed=True)  # -> flatten(Polyline)
region_difference = RegionDifference(CurvesA=polygon.Polygon, CurvesB=polyline)
number_slider_2 = Slider(1, range=0..1)
multiplication = Multiplication(A=number_slider, B=Slider(2, range=0..10))
unit_z = UnitZ(Factor=multiplication)
extrude = Extrude(Base=region_difference, Direction=unit_z)
number_slider_3 = Slider(10, range=0..10)
cap_holes = CapHoles(Brep=extrude)
loop_start = LoopStart(Repeat=Slider(100, range=0..100), Trigger=Toggle(False), Data=cap_holes)  # -> port, Counter, Data; disabled
reverse_list = ReverseList(List=loop_start.Data)
# RIGHT CLICK THIS COMPONENET AND CLICK 'ENABLED'
panel = Panel(loop_start.Counter)
list_item = ListItem(List=reverse_list, Index=Slider(0, range=0..100), Wrap=True)
deconstruct_brep = DeconstructBrep(Brep=list_item)  # -> Faces, Edges, Vertices
addition = Addition(A=loop_start.Counter, B=Slider(1, range=0..1))
area = Area(Geometry=deconstruct_brep.Faces)  # -> Area, Centroid
curve = Curve(reparameterize(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))
multiplication_2 = Multiplication(A=addition, B=Slider(0.012, range=0..1))
sort_list = SortList(Keys=area.Area, ValuesValuesA=deconstruct_brep.Faces, ValuesA=area.Centroid)  # -> Keys, ValuesValuesA, ValuesA
number_slider_4 = Slider(3, range=0..10)
evaluate_curve = EvaluateCurve(Curve=curve, Parameter=multiplication_2)  # -> Point, Tangent, Angle
split_list = SplitList(List=sort_list.ValuesValuesA, Index=number_slider_4)  # -> ListA, ListB
split_list_2 = SplitList(List=sort_list.ValuesA, Index=number_slider_4)  # -> ListA, ListB
closest_point = ClosestPoint(Point=evaluate_curve.Point, Cloud=split_list_2.ListA)  # -> ClosestPoint, CPIndex, Distance
geometry = Geometry([split_list.ListA, split_list_2.ListA])
list_item_2 = ListItem(List=split_list.ListA, Index=closest_point.CPIndex, Wrap=True)
md_slider = MDSlider(slider_value=Point(0.5, 0.5, 0.5), SliderMode=0, x_domain=Domain(0, 1), y_domain=Domain(0, 1), z_domain=Domain(0, 1))
evaluate_surface = EvaluateSurface(Surface=reparameterize(list_item_2), Point=md_slider)  # -> Point, Normal, Frame
plane_normal = PlaneNormal(Origin=closest_point.ClosestPoint, ZAxis=evaluate_surface.Normal)
mirror = Mirror(Geometry=list_item, Plane=plane_normal)  # -> Geometry, Transform
rotate = Rotate(Geometry=mirror.Geometry, Angle=1.570796327, Plane=plane_normal)  # -> Geometry, Transform
merge_2 = Merge(Data1=loop_start.Data, Data2=rotate.Geometry)  # -> flatten(Result)
running = Running(port=loop_start.port, Exit=False, Data=merge_2, pausedState=False, state="Constant output", TimeOutVal=0)
geometry_2 = Geometry(running)
