# Grasshopper definition hex_2.gh (Grasshopper 0.9.76)

number_slider = Slider(6, range=0..10)
polygon = Polygon(Plane=PlaneXY(0, 0, 0), Radius=3, Segments=number_slider, FilletRadius=0)  # -> reparameterize(Polygon), Length
rectangular_array = RectangularArray(Geometry=polygon.Polygon, Cell={Plane=PlaneXY(0, 0, 0), Size=Domain2(u=0..10, v=0..5)}, XCount=6, YCount=3)  # -> Geometry, Transform
geometry = Geometry(polygon.Polygon)
area = Area(Geometry=geometry)  # -> Area, Centroid
explode = Explode(Curve=geometry, Recursive=True)  # -> reparameterize(Segments), Vertices
length = Length(Curve=explode.Segments)
construct_domain = ConstructDomain(DomainStart=Slider(0, range=0..100), DomainEnd=Slider(5, range=0..10))
construct_domain_2 = ConstructDomain(DomainStart=Slider(0, range=0..100), DomainEnd=Slider(3, range=0..10))
point_on_curve = PointOnCurve(explode.Segments, parameter=0.5)
random = Random(Range=construct_domain, Number=Slider(2, range=0..10), Seed=Slider(2, range=0..10), Integers=True)
point_list = PointList(Points=point_on_curve, Size=Slider(2.813, range=0..10))
random_2 = Random(Range=construct_domain_2, Number=Slider(2, range=0..10), Seed=2, Integers=True)
panel = Panel(random)
list_item = ListItem(List=point_on_curve, Index=random, Wrap=True)
xy_plane = XYPlane(Origin=Point(0, 0, 0))
perp_frame = PerpFrame(Curve=simplify(graft(explode.Segments)), Parameter=Slider(0.5, range=0..1))
cull_index = CullIndex(List=point_on_curve, Indices=random, Wrap=True)
cull_index_2 = CullIndex(List=cull_index, Indices=random_2, Wrap=True)
plane_origin = PlaneOrigin(Base=xy_plane, Origin=point_on_curve)
radians = Radians(Degrees=Slider(90, range=0..100))
weave = Weave(Pattern=[0, 1], Stream0=list_item, Stream1=area.Centroid, NullGaps=False)
list_item_2 = ListItem(List=cull_index, Index=random_2, Wrap=True)
panel_2 = Panel(point_on_curve)
rotate = Rotate(Geometry=flatten(perp_frame), Angle=radians, Plane=plane_origin)  # -> Geometry, Transform
mirror = Mirror(Geometry=geometry, Plane=rotate.Geometry)  # -> Geometry, Transform
weave_2 = Weave(Pattern=[0, 1], Stream0=list_item_2, Stream1=area.Centroid, NullGaps=False)
weave_3 = Weave(Pattern=[0, 1], Stream0=cull_index_2, Stream1=area.Centroid, NullGaps=False)
hexagonal = Hexagonal(Plane=PlaneXY(0, 0, 0), Size=Slider(3, range=0..10), ExtentX=Slider(20, range=0..100), ExtentY=Slider(10, range=0..10))  # -> Cells, Points
list_length = ListLength(List=simplify(flatten(hexagonal.Points)))  # -> simplify(Length)
geometry_2 = Geometry(mirror.Geometry)
series = Series(Start=0, Step=1, Count=list_length)
panel_3 = Panel(hexagonal.Points)
multiplication = Multiplication(A=series, B=Slider(15, range=0..100))
dispatch = Dispatch(List=flatten(geometry_2), DispatchPattern=[True, False])  # -> ListA, ListB
explode_2 = Explode(Curve=hexagonal.Cells, Recursive=True)  # -> Segments, Vertices
area_2 = Area(Geometry=hexagonal.Cells)  # -> Area, graft(Centroid)
explode_3 = Explode(Curve=geometry_2, Recursive=True)  # -> Segments, Vertices
area_3 = Area(Geometry=geometry_2)  # -> Area, graft(Centroid)
explode_4 = Explode(Curve=dispatch.ListB, Recursive=True)  # -> Segments, Vertices
construct_point = ConstructPoint(XCoordinate=0, YCoordinate=0, ZCoordinate=0)
construct_domain_3 = ConstructDomain(DomainStart=Slider(0, range=0..100), DomainEnd=Slider(5, range=0..10))
construct_point_2 = ConstructPoint(XCoordinate=0, YCoordinate=0, ZCoordinate=0)
point_on_curve_2 = PointOnCurve(explode_2.Segments, parameter=0.5)
construct_domain_4 = ConstructDomain(DomainStart=Slider(0, range=0..100), DomainEnd=Slider(3, range=0..10))
explode_5 = Explode(Curve=dispatch.ListA, Recursive=True)  # -> Segments, Vertices
area_4 = Area(Geometry=dispatch.ListB)  # -> Area, Centroid
point_on_curve_3 = PointOnCurve(explode_3.Segments, parameter=0.5)
area_5 = Area(Geometry=dispatch.ListA)  # -> Area, Centroid
multiplication_2 = Multiplication(A=series, B=50)
vector_2pt = Vector2Pt(PointA=construct_point, PointB=area_5.Centroid, Unitize=False)  # -> Vector, Length
vector_2pt_2 = Vector2Pt(PointA=construct_point_2, PointB=area_4.Centroid, Unitize=False)  # -> Vector, Length
random_3 = Random(Range=construct_domain_3, Number=Slider(2, range=0..10), Seed=2)
series_2 = Series(Start=0, Step=1, Count=Slider(4, range=0..10))
random_4 = Random(Range=construct_domain_4, Number=Slider(2, range=0..10), Seed=4)
series_3 = Series(Start=0, Step=1, Count=Slider(6, range=0..10))
point_on_curve_4 = PointOnCurve(explode_4.Segments, parameter=0.5)
point_on_curve_5 = PointOnCurve(explode_5.Segments, parameter=0.5)
amplitude = Amplitude(Vector=vector_2pt_2.Vector, Amplitude=expr("x/3", number_slider))
move = Move(Geometry=area_4.Centroid, Motion=amplitude)  # -> Geometry, Transform
amplitude_2 = Amplitude(Vector=vector_2pt.Vector, Amplitude=expr("x/3", number_slider))
move_2 = Move(Geometry=area_5.Centroid, Motion=amplitude_2)  # -> Geometry, Transform
jitter = Jitter(List=series_2, Jitter=1, Seed=graft(multiplication))  # -> Values, Indices
jitter_2 = Jitter(List=series_3, Jitter=1, Seed=multiplication_2)  # -> simplify(Values), Indices
integer = Integer(random_3)
list_item_3 = ListItem(List=point_on_curve_3, Index=integer, Wrap=True)
integer_2 = Integer(random_4)
closest_points = ClosestPoints(Point=graft(move.Geometry), Cloud=point_on_curve_4, Count=Slider(1, range=0..1))  # -> ClosestPoint, CPIndex, Distance
closest_points_2 = ClosestPoints(Point=graft(move_2.Geometry), Cloud=point_on_curve_5, Count=3)  # -> ClosestPoint, CPIndex, Distance
list_item_4 = ListItem(List=jitter.Values, Index=0, Wrap=True)  # -> Item, Item1
cull_index_3 = CullIndex(List=point_on_curve_3, Indices=integer, Wrap=True)
cull_index_4 = CullIndex(List=cull_index_3, Indices=integer_2, Wrap=True)
list_item_5 = ListItem(List=jitter_2.Values, Index=0, Wrap=True)  # -> Item, Item1
weave_4 = Weave(Pattern=[0, 1], Stream0=list_item_3, Stream1=area_3.Centroid, NullGaps=False)
merge = Merge(Data1=list_item_4.Item, Data2=list_item_4.Item1)
list_item_6 = ListItem(List=cull_index_3, Index=integer_2, Wrap=True)
merge_2 = Merge(Data1=list_item_5.Item, Data2=list_item_5.Item1)
cull_index_5 = CullIndex(List=point_on_curve_2, Indices=merge_2, Wrap=True)
cull_index_6 = CullIndex(List=cull_index_5, Indices=merge, Wrap=True)
list_item_7 = ListItem(List=explode_4.Segments, Index=closest_points.CPIndex, Wrap=True)
list_item_8 = ListItem(List=explode_5.Segments, Index=closest_points_2.CPIndex, Wrap=True)
list_item_9 = ListItem(List=point_on_curve_2, Index=merge_2, Wrap=True)
list_item_10 = ListItem(List=cull_index_5, Index=merge, Wrap=True)
weave_5 = Weave(Pattern=[0, 1], Stream0=list_item_6, Stream1=area_3.Centroid, NullGaps=False)
weave_6 = Weave(Pattern=[0, 1], Stream0=cull_index_6, Stream1=area_2.Centroid, NullGaps=False)
weave_7 = Weave(Pattern=[0, 1], Stream0=cull_index_4, Stream1=area_3.Centroid, NullGaps=False)
weave_8 = Weave(Pattern=[0, 1], Stream0=simplify(list_item_9), Stream1=simplify(area_2.Centroid), NullGaps=False)
weave_9 = Weave(Pattern=[0, 1], Stream0=list_item_10, Stream1=area_2.Centroid, NullGaps=False)
xy_plane_2 = XYPlane(Origin=Point(0, 0, 0))
xy_plane_3 = XYPlane(Origin=Point(0, 0, 0))
perp_frame_2 = PerpFrame(Curve=reparameterize(simplify(list_item_7)), Parameter=Slider(0.5, range=0..1))
perp_frame_3 = PerpFrame(Curve=reparameterize(simplify(list_item_8)), Parameter=Slider(0.5, range=0..1))
plane_origin_2 = PlaneOrigin(Base=xy_plane_2, Origin=closest_points.ClosestPoint)
radians_2 = Radians(Degrees=Slider(90, range=0..100))
plane_origin_3 = PlaneOrigin(Base=xy_plane_3, Origin=closest_points_2.ClosestPoint)
radians_3 = Radians(Degrees=Slider(90, range=0..100))
rotate_2 = Rotate(Geometry=perp_frame_2, Angle=radians_2, Plane=plane_origin_2)  # -> Geometry, Transform
rotate_3 = Rotate(Geometry=perp_frame_3, Angle=radians_3, Plane=plane_origin_3)  # -> Geometry, Transform
number_slider_2 = Slider(0.1, range=0..1)
nurbs_curve = NurbsCurve(Vertices=simplify(weave_9), Degree=2, Periodic=False)  # -> flatten(Curve), Length, Domain
nurbs_curve_2 = NurbsCurve(Vertices=weave_8, Degree=2, Periodic=False)  # -> flatten(Curve), Length, Domain
nurbs_curve_3 = NurbsCurve(Vertices=weave_6, Degree=2, Periodic=False)  # -> flatten(Curve), Length, Domain
number_slider_3 = Slider(4, range=0..10)
mirror_2 = Mirror(Geometry=graft(dispatch.ListA), Plane=simplify(rotate_3.Geometry))  # -> Geometry, Transform
mirror_3 = Mirror(Geometry=graft(dispatch.ListB), Plane=rotate_2.Geometry)  # -> Geometry, Transform
construct_domain_5 = ConstructDomain(DomainStart=number_slider_2, DomainEnd=Slider(0.47, range=0..2))
merge_3 = Merge(Data1=nurbs_curve_2.Curve, Data2=nurbs_curve.Curve, Data3=nurbs_curve_3.Curve)
join_curves = JoinCurves(Curves=merge_3, Preserve=False)
division = Division(A=Slider(1, range=0..1), B=number_slider_3)
range = Range(Domain=construct_domain_5, Steps=expr("x/2", number_slider_3))  # -> flatten(Range)
list_item_11 = ListItem(List=join_curves, Index=Slider(12, range=0..40), Wrap=True)
series_4 = Series(Start=0, Step=division, Count=expr("x+1", number_slider_3))
reverse_list = ReverseList(List=range)
merge_4 = Merge(Data1=flatten(mirror_2.Geometry), Data2=mirror_3.Geometry)  # -> flatten(Result)
random_reduce = RandomReduce(Seed=1)
cull_index_7 = CullIndex(List=reverse_list, Indices=Slider(0, range=0..100), Wrap=True)  # -> flatten(List)
curve = Curve(reparameterize(join_curves))
# increse randum number generation to number of hexagons and ensure the random numbers are not the same
panel_4 = Panel("http://www.grasshopper3d.com/forum/topics/random-component-1")
merge_5 = Merge(Data1=range, Data2=cull_index_7)
closed = Closed(Curve=curve)  # -> Closed, Periodic
dispatch_2 = Dispatch(List=curve, DispatchPattern=closed.Closed)  # -> ListA, ListB
number_slider_4 = Slider(1, range=0..1)
pipe_variable = PipeVariable(Curve=graft(dispatch_2.ListB), Parameters=series_4, Radii=merge_5, Caps=number_slider_4)
curve_2 = Curve(dispatch_2.ListA)
pipe = Pipe(Curve=curve_2, Radius=number_slider_2, Caps=number_slider_4)
area_6 = Area(Geometry=merge_4)  # -> Area, Centroid
list_item_12 = ListItem(List=area_6.Centroid, Index=0, Wrap=True)  # -> Item, Item1, Item2, Item3
circle_3pt = Circle3Pt(PointA=list_item_12.Item3, PointB=list_item_12.Item1, PointC=list_item_12.Item2)  # -> Circle, Plane, Radius
sort_along_curve = SortAlongCurve(Points=area_6.Centroid, Curve=circle_3pt.Circle)  # -> Points, Indices
solid_union = SolidUnion(Breps=flatten([pipe, pipe_variable]))
list_item_13 = ListItem(List=merge_4, Index=sort_along_curve.Indices, Wrap=True)
area_7 = Area(Geometry=list_item_13)  # -> Area, Centroid
point_list_2 = PointList(Points=area_7.Centroid, Size=Slider(5, range=0..10))
explode_6 = Explode(Curve=merge_4, Recursive=True)  # -> Segments, Vertices
dispatch_3 = Dispatch(List=list_item_13, DispatchPattern=[True, False])  # -> ListA, ListB
area_8 = Area(Geometry=merge_4)  # -> Area, graft(Centroid)
construct_domain_6 = ConstructDomain(DomainStart=Slider(0, range=0..100), DomainEnd=Slider(5, range=0..10))
construct_domain_7 = ConstructDomain(DomainStart=Slider(0, range=0..100), DomainEnd=Slider(3, range=0..10))
point_on_curve_6 = PointOnCurve(explode_6.Segments, parameter=0.5)
random_5 = Random(Range=construct_domain_6, Number=Slider(2, range=0..10), Seed=6)
construct_point_3 = ConstructPoint(XCoordinate=0, YCoordinate=0, ZCoordinate=0)
random_6 = Random(Range=construct_domain_7, Number=Slider(2, range=0..10), Seed=3)
explode_7 = Explode(Curve=dispatch_3.ListA, Recursive=True)  # -> Segments, Vertices
area_9 = Area(Geometry=dispatch_3.ListA)  # -> Area, Centroid
vector_2pt_3 = Vector2Pt(PointA=construct_point_3, PointB=area_9.Centroid, Unitize=False)  # -> Vector, Length
integer_3 = Integer(random_5)
list_item_14 = ListItem(List=point_on_curve_6, Index=integer_3, Wrap=True)
integer_4 = Integer(random_6)
point_on_curve_7 = PointOnCurve(explode_7.Segments, parameter=0.5)
cull_index_8 = CullIndex(List=point_on_curve_6, Indices=integer_3, Wrap=True)
cull_index_9 = CullIndex(List=cull_index_8, Indices=integer_4, Wrap=True)
amplitude_3 = Amplitude(Vector=vector_2pt_3.Vector, Amplitude=expr("x/3", number_slider))
weave_10 = Weave(Pattern=[0, 1], Stream0=list_item_14, Stream1=area_8.Centroid, NullGaps=False)
move_3 = Move(Geometry=area_9.Centroid, Motion=amplitude_3)  # -> Geometry, Transform
list_item_15 = ListItem(List=cull_index_8, Index=integer_4, Wrap=True)
closest_points_3 = ClosestPoints(Point=graft(move_3.Geometry), Cloud=point_on_curve_7, Count=3)  # -> ClosestPoint, CPIndex, Distance
weave_11 = Weave(Pattern=[0, 1], Stream0=list_item_15, Stream1=area_8.Centroid, NullGaps=False)
weave_12 = Weave(Pattern=[0, 1], Stream0=cull_index_9, Stream1=area_8.Centroid, NullGaps=False)
list_item_16 = ListItem(List=explode_7.Segments, Index=closest_points_3.CPIndex, Wrap=True)
xy_plane_4 = XYPlane(Origin=Point(0, 0, 0))
perp_frame_4 = PerpFrame(Curve=reparameterize(simplify(list_item_16)), Parameter=Slider(0.5, range=0..1))
plane_origin_4 = PlaneOrigin(Base=xy_plane_4, Origin=closest_points_3.ClosestPoint)
radians_4 = Radians(Degrees=Slider(90, range=0..100))
rotate_4 = Rotate(Geometry=perp_frame_4, Angle=radians_4, Plane=plane_origin_4)  # -> Geometry, Transform
mirror_4 = Mirror(Geometry=graft(dispatch_3.ListA), Plane=simplify(rotate_4.Geometry))  # -> Geometry, Transform
explode_8 = Explode(Curve=mirror_4.Geometry, Recursive=True)  # -> Segments, Vertices
area_10 = Area(Geometry=mirror_4.Geometry)  # -> Area, graft(Centroid)
construct_domain_8 = ConstructDomain(DomainStart=Slider(0, range=0..100), DomainEnd=Slider(3, range=0..10))
construct_domain_9 = ConstructDomain(DomainStart=Slider(0, range=0..100), DomainEnd=Slider(5, range=0..10))
point_on_curve_8 = PointOnCurve(explode_8.Segments, parameter=0.5)
random_7 = Random(Range=construct_domain_8, Number=Slider(2, range=0..10), Seed=4)
random_8 = Random(Range=construct_domain_9, Number=Slider(2, range=0..10), Seed=5)
integer_5 = Integer(random_8)
list_item_17 = ListItem(List=point_on_curve_8, Index=integer_5, Wrap=True)
integer_6 = Integer(random_7)
cull_index_10 = CullIndex(List=point_on_curve_8, Indices=integer_5, Wrap=True)
cull_index_11 = CullIndex(List=cull_index_10, Indices=integer_6, Wrap=True)
weave_13 = Weave(Pattern=[0, 1], Stream0=list_item_17, Stream1=area_10.Centroid, NullGaps=False)
list_item_18 = ListItem(List=cull_index_10, Index=integer_6, Wrap=True)
weave_14 = Weave(Pattern=[0, 1], Stream0=list_item_18, Stream1=area_10.Centroid, NullGaps=False)
weave_15 = Weave(Pattern=[0, 1], Stream0=cull_index_11, Stream1=area_10.Centroid, NullGaps=False)

nurbs_curve_4 = NurbsCurve(Vertices=weave, Degree=2, Periodic=False)  # -> Curve, Length, Domain
nurbs_curve_5 = NurbsCurve(Vertices=weave_2, Degree=2, Periodic=False)  # -> Curve, Length, Domain
nurbs_curve_6 = NurbsCurve(Vertices=weave_3, Degree=2, Periodic=False)  # -> Curve, Length, Domain
nurbs_curve_7 = NurbsCurve(Vertices=weave_4, Degree=2, Periodic=False)  # -> Curve, Length, Domain
nurbs_curve_8 = NurbsCurve(Vertices=weave_5, Degree=2, Periodic=False)  # -> Curve, Length, Domain
nurbs_curve_9 = NurbsCurve(Vertices=weave_7, Degree=2, Periodic=False)  # -> Curve, Length, Domain
nurbs_curve_10 = NurbsCurve(Vertices=weave_10, Degree=2, Periodic=False)  # -> Curve, Length, Domain
nurbs_curve_11 = NurbsCurve(Vertices=weave_11, Degree=2, Periodic=False)  # -> Curve, Length, Domain
nurbs_curve_12 = NurbsCurve(Vertices=weave_12, Degree=2, Periodic=False)  # -> Curve, Length, Domain
nurbs_curve_13 = NurbsCurve(Vertices=weave_13, Degree=2, Periodic=False)  # -> Curve, Length, Domain
nurbs_curve_14 = NurbsCurve(Vertices=weave_14, Degree=2, Periodic=False)  # -> Curve, Length, Domain
nurbs_curve_15 = NurbsCurve(Vertices=weave_15, Degree=2, Periodic=False)  # -> Curve, Length, Domain
