# Grasshopper definition octo_2_2.gh (Grasshopper 0.9.76)

material_thickness = Slider(3.55, range=0..71)
number_slider = Slider(75, range=0..210)
construct_point = ConstructPoint(XCoordinate=number_slider, YCoordinate=0, ZCoordinate=0)
division = Division(A=material_thickness, B=2)
xz_plane = XZPlane(Origin=construct_point)
division_2 = Division(A=number_slider, B=Slider(2, range=0..10))
vector_xyz = VectorXYZ(XComponent=expr("-X", 0), YComponent=expr("-X", division), ZComponent=0)  # -> Vector, Length
subtraction = Subtraction(A=number_slider, B=division_2)
vector_xyz_2 = VectorXYZ(XComponent=expr("-X", 0), YComponent=expr("-X", 0), ZComponent=expr("-x", division))  # -> Vector, Length
vector_xyz_3 = VectorXYZ(XComponent=0, YComponent=division, ZComponent=0)  # -> Vector, Length
vector_xyz_4 = VectorXYZ(XComponent=0, YComponent=0, ZComponent=division)  # -> Vector, Length
vector_xyz_5 = VectorXYZ(XComponent=Slider(1, range=0..1), YComponent=0, ZComponent=0)  # -> Vector, Length
polygon = Polygon(Plane=PlaneXY(0, 0, 0), Radius=number_slider, Segments=3, FilletRadius=Slider(1, range=0..10))  # -> Polygon, Length
explode = Explode(Curve=polygon.Polygon, Recursive=True)  # -> flatten(Segments), Vertices
circle = Circle(Plane=xz_plane, Radius=division_2)
construct_point_2 = ConstructPoint(XCoordinate=subtraction, YCoordinate=0, ZCoordinate=0)
merge = Merge(Data1=vector_xyz_4.Vector, Data2=vector_xyz_2.Vector)  # -> simplify(graft(Result))
merge_2 = Merge(Data1=vector_xyz_3.Vector, Data2=vector_xyz.Vector)  # -> simplify(graft(Result))
list_item = ListItem(List=explode.Segments, Index=Slider(5, range=0..6), Wrap=True)
plane_normal = PlaneNormal(Origin=Point(0, 0, 0), ZAxis=vector_xyz_5.Vector)
extrude = Extrude(Base=circle, Direction=merge_2)  # -> flatten(Extrusion)
geometry = Geometry(polygon.Polygon)
geometry_2 = Geometry(circle)
point_on_curve = PointOnCurve(list_item, parameter=0.5)
move = Move(Geometry=construct_point_2, Motion=vector_xyz.Vector)  # -> Geometry, Transform
number_slider_2 = Slider(3, range=0..10)
move_2 = Move(Geometry=point_on_curve, Motion=vector_xyz_3.Vector)  # -> Geometry, Transform
rotate = Rotate(Geometry=geometry_2, Angle=1.570796327, Plane=plane_normal)  # -> Geometry, Transform
panel = Panel("""109.471
180
289.471""")
brep_join = BrepJoin(Breps=extrude)  # -> Breps, Closed
extrude_2 = Extrude(Base=polygon.Polygon, Direction=merge)  # -> flatten(Extrusion)
cap_holes = CapHoles(Brep=brep_join.Breps)
xy_plane = XYPlane(Origin=point_on_curve)
area = Area(Geometry=rotate.Geometry)  # -> Area, Centroid
brep_join_2 = BrepJoin(Breps=extrude_2)  # -> Breps, Closed
radians = Radians(Degrees=panel)
xy_plane_2 = XYPlane(Origin=construct_point_2)
rectangle_2pt = Rectangle2Pt(Plane=PlaneXY(0, 0, 0), PointA=move.Geometry, PointB=move_2.Geometry, Radius=0)  # -> Rectangle, Length
number_slider_3 = Slider(0.5, range=0..1)
division_3 = Division(A="-70.529", B=Slider(2, range=0..10))
xy_plane_3 = XYPlane(Origin=area.Centroid)
cap_holes_2 = CapHoles(Brep=brep_join_2.Breps)
radians_2 = Radians(Degrees=division_3)
scale_nu = ScaleNU(Geometry=rectangle_2pt.Rectangle, Plane=xy_plane, ScaleX=number_slider_3, ScaleY=1, ScaleZ=1)  # -> Geometry, Transform
curve = Curve(scale_nu.Geometry)
polar_array = PolarArray(Geometry=curve, Plane=PlaneXY(0, 0, 0), Count=Slider(3, range=0..10), Angle=6.283185307)  # -> Geometry, Transform
scale_nu_2 = ScaleNU(Geometry=rectangle_2pt.Rectangle, Plane=xy_plane_2, ScaleX=number_slider_3, ScaleY=1, ScaleZ=1)  # -> Geometry, Transform
curve_2 = Curve(scale_nu_2.Geometry)
rotate_2 = Rotate(Geometry=curve_2, Angle=radians, Plane=xy_plane_3)  # -> Geometry, Transform
rotate_3 = Rotate(Geometry=curve_2, Angle=radians_2, Plane=xy_plane_3)  # -> Geometry, Transform
merge_3 = Merge(Data1=curve_2, Data2=rotate_2.Geometry, Data3=rotate_3.Geometry)
extrude_3 = Extrude(Base=scale_nu.Geometry, Direction=merge)  # -> flatten(Extrusion)
extrude_4 = Extrude(Base=scale_nu_2.Geometry, Direction=merge)  # -> flatten(Extrusion)
interpolate_t = InterpolateT(Degree=3, TangentStart=Vector(0, 0, 0), TangentEnd=Vector(0, 0, 0), KnotStyle=1)  # -> Curve, Length, Domain
rotate_4 = Rotate(Geometry=xy_plane_3, Angle=radians_2, Plane=PlaneXY(0, 0, 0))  # -> Geometry, Transform
brep_join_3 = BrepJoin(Breps=extrude_4)  # -> Breps, Closed
region_difference = RegionDifference(CurvesA=geometry, CurvesB=polar_array.Geometry)
brep_join_4 = BrepJoin(Breps=extrude_3)  # -> Breps, Closed
nurbs_curve = NurbsCurve(Degree=3, Periodic=False)  # -> Curve, Length, Domain
region_difference_2 = RegionDifference(CurvesA=rotate.Geometry, CurvesB=merge_3)
cap_holes_3 = CapHoles(Brep=brep_join_3.Breps)
solid_difference = SolidDifference(BrepsA=cap_holes, BrepsB=cap_holes_3)
polar_array_2 = PolarArray(Geometry=solid_difference, Plane=PlaneXY(0, 0, 0), Count=number_slider_2, Angle=6.283185307)  # -> Geometry, Transform
volume = Volume(Geometry=polar_array_2.Geometry)  # -> Volume, Centroid
cap_holes_4 = CapHoles(Brep=brep_join_4.Breps)
polar_array_3 = PolarArray(Geometry=cap_holes_4, Plane=PlaneXY(0, 0, 0), Count=number_slider_2, Angle=6.283185307)  # -> Geometry, Transform
solid_difference_2 = SolidDifference(BrepsA=cap_holes_2, BrepsB=polar_array_3.Geometry)
geometry_3 = Geometry([solid_difference_2, polar_array_2.Geometry])
radians_3 = Radians(Degrees=Slider(109.471, range=0..200))
scale_nu_3 = ScaleNU(Geometry=rotate_3.Geometry, Plane=rotate_4.Geometry, ScaleX=Slider(1.023, range=0..5), ScaleY=1, ScaleZ=1)  # -> Geometry, Transform
rotate_5 = Rotate(Geometry=geometry_3, Angle=radians_3, Plane=xz_plane)  # -> Geometry, Transform
polar_array_4 = PolarArray(Geometry=rotate_5.Geometry, Plane=PlaneXY(0, 0, 0), Count=Slider(3, range=0..10), Angle=6.283185307)  # -> Geometry, Transform
volume_2 = Volume(Geometry=polar_array_4.Geometry)  # -> Volume, flatten(Centroid)
panel_2 = Panel(volume_2.Volume)
point_list = PointList(Points=volume_2.Centroid, Size=Slider(3.584, range=0..50))
list_item_2 = ListItem(List=volume_2.Centroid, Index=Slider(7, range=0..10), Wrap=True)
merge_4 = Merge(Data1=polar_array_4.Geometry, Data2=geometry_3)
deconstruct = Deconstruct(Point=list_item_2)  # -> XComponent, YComponent, ZComponent
construct_point_3 = ConstructPoint(XCoordinate=0, YCoordinate=0, ZCoordinate=deconstruct.ZComponent)
xy_plane_4 = XYPlane(Origin=construct_point_3)
mirror = Mirror(Geometry=merge_4, Plane=xy_plane_4)  # -> Geometry, Transform
radians_4 = Radians(Degrees=Slider(60, range=0..150))
rotate_6 = Rotate(Geometry=mirror.Geometry, Angle=radians_4, Plane=xy_plane_4)  # -> Geometry, Transform
