# Grasshopper definition shelf_forcutting170212.gh (Grasshopper 0.9.76)

gap_width = Slider(3.65, range=0..4)
diameter_of_piece = Slider(40, range=0..50)
radius_of_fillet = Slider(1, range=0..10)
multiplication = Multiplication(A=diameter_of_piece, B=Slider(0.5, range=0..1))
polygon = Polygon(Plane=PlaneXY(0, 0, 0), Radius=diameter_of_piece, Segments=3, FilletRadius=0)  # -> Polygon, Length
division = Division(A=gap_width, B=2)
circle = Circle(Plane=PlaneXY(0, 0, 0), Radius=multiplication)
unit_y = UnitY(Factor=expr("-x", division))
point_on_curve = PointOnCurve(circle, parameter=0)
point_on_curve_2 = PointOnCurve(polygon.Polygon, parameter=0)
xy_plane = XYPlane(Origin=point_on_curve)
xy_plane_2 = XYPlane(Origin=point_on_curve_2)
move = Move(Geometry=xy_plane_2, Motion=unit_y)  # -> Geometry, Transform
multiplication_2 = Multiplication(A=multiplication, B=Slider(-1, range=-1..0))
move_2 = Move(Geometry=xy_plane, Motion=unit_y)  # -> Geometry, Transform
multiplication_3 = Multiplication(A=multiplication, B=Slider(-0.5, range=-0.5..0))
rectangle = Rectangle(Plane=move.Geometry, XSize=multiplication_3, YSize=gap_width, Radius=0)  # -> Rectangle, Length
polar_array = PolarArray(Geometry=rectangle.Rectangle, Plane=PlaneXY(0, 0, 0), Count=Slider(3, range=0..10), Angle=6.283185307)  # -> Geometry, Transform
rectangle_2 = Rectangle(Plane=move_2.Geometry, XSize=multiplication_3, YSize=gap_width, Radius=0)  # -> Rectangle, Length
panel = Panel("""35.2645
144.7355
215.2645
324.7355""")
radians = Radians(Degrees=panel)
rectangle_3 = Rectangle(Plane=move_2.Geometry, XSize=multiplication_2, YSize=gap_width, Radius=0)  # -> Rectangle, Length
rotate = Rotate(Geometry=rectangle_2.Rectangle, Angle=radians, Plane=PlaneXY(0, 0, 0))  # -> Geometry, Transform
region_difference = RegionDifference(CurvesA=polygon.Polygon, CurvesB=polar_array.Geometry)
merge = Merge(Data1=rotate.Geometry, Data2=rectangle_3.Rectangle)
explode = Explode(Curve=region_difference, Recursive=True)  # -> Segments, Vertices
region_difference_2 = RegionDifference(CurvesA=circle, CurvesB=merge)
length = Length(Curve=explode.Segments)
sort_list = SortList(Keys=length, ValuesValuesA=explode.Segments)  # -> Keys, ValuesValuesA
explode_2 = Explode(Curve=region_difference_2, Recursive=True)  # -> Segments, Vertices
split_list = SplitList(List=sort_list.ValuesValuesA, Index=Slider(3, range=0..10))  # -> ListA, ListB
length_2 = Length(Curve=explode_2.Segments)
join_curves = JoinCurves(Curves=split_list.ListB, Preserve=False)
sort_list_2 = SortList(Keys=length_2, ValuesValuesA=explode_2.Segments)  # -> Keys, ValuesValuesA
fillet = Fillet(Curve=join_curves, Radius=radius_of_fillet)
split_list_2 = SplitList(List=sort_list_2.ValuesValuesA, Index=Slider(5, range=0..10))  # -> ListA, ListB
end_points = EndPoints(Curve=fillet)  # -> graft(Start), End
join_curves_2 = JoinCurves(Curves=split_list_2.ListB, Preserve=False)
closest_point = ClosestPoint(Point=end_points.Start, Cloud=end_points.End)  # -> ClosestPoint, CPIndex, Distance
fillet_2 = Fillet(Curve=join_curves_2, Radius=radius_of_fillet)
discontinuity = Discontinuity(Curve=fillet_2, Level=1)  # -> Points, Parameters
line = Line(StartPoint=end_points.Start, EndPoint=closest_point.ClosestPoint)
split_list_3 = SplitList(List=discontinuity.Points, Index=Slider(1, range=0..1))  # -> ListA, flatten(ListB)
number_slider = Slider(3, range=0..10)
closest_point_2 = ClosestPoint(Point=split_list_3.ListA, Cloud=split_list_3.ListB)  # -> ClosestPoint, CPIndex, Distance
point_list = PointList(Points=split_list_3.ListB, Size=number_slider)
point_list_2 = PointList(Points=split_list_3.ListA, Size=number_slider)
line_2 = Line(StartPoint=split_list_3.ListA, EndPoint=closest_point_2.ClosestPoint)
join_curves_3 = JoinCurves(Curves=[line, fillet], Preserve=False)
join_curves_4 = JoinCurves(Curves=[line_2, fillet_2], Preserve=False)
